# Grasshopper definition GH-Nanobana.gh (Grasshopper 1.0.8)

# Post-processed
panel = Panel("""make a 
 space station sorrounded by a dark blue universe based on the geometry of the image attached. Try to maintain visual coherence to the input image. Keep same proportions, perspective and camera position.""")

# ----
# Authenticate
# Go to https://aistudio.google.com/api-keys go generare your api-key
# Visit https://ai.google.dev/gemini-api/docs/image-generation for examples on how to use nanobanana
paste_your_api_key = Panel("")

# ----
# Viewport to Image
panel_2 = Panel("""make a 
 space shuttle with a dark blue universe based on the image i provided you.""")
panel_3 = Panel("In the style of Wes Anderson")
# Txt to Image
panel_4 = Panel("make an architectural drawing of a spaceship")
py3 = Python3Script(V="base")  # -> out, D; inputs V: String
# ---------- py3: Python ----------
"""Grasshopper Script"""

import os
import Rhino
import System
import base64
from io import BytesIO
from base64 import b64encode, b64decode

v = V

if v != None:
    VIEWPORT = v

    view = Rhino.RhinoDoc.ActiveDoc.Views.Find(VIEWPORT, False)
    if not view:
        raise ValueError(f"Viewport '{VIEWPORT}' not found.")

    # Capture viewport as bitmap
    size = view.ActiveViewport.Size
    bitmap = view.CaptureToBitmap(System.Drawing.Size(size.Width, size.Height))

    # Convert to PNG bytes in memory using .NET stream
    stream = System.IO.MemoryStream()
    bitmap.Save(stream, System.Drawing.Imaging.ImageFormat.Png)
    byte_data = bytearray(stream.ToArray())  # Convert .NET byte[] → Python bytes
    stream.Close()

    b64img = base64.b64encode(byte_data).decode("utf-8")

    D = b64img
# ---------- end py3 ----------
py3_2 = Python3Script(V="base")  # -> out, D; inputs V: String; same code as py3
style = Text(panel_3)
py3_3 = Python3Script(K=paste_your_api_key, I=panel_4, r="1:1", run=Toggle(True))  # -> out, P; inputs K: String, I: list of String, r: String, run: Boolean; disabled
# ---------- py3_3: Python ----------
"""Grasshopper Script"""
# requirements: pillow, google-genai

import os
import Rhino
import System
import base64
from google import genai
from google.genai import types
from PIL import Image
from io import BytesIO
from base64 import b64encode, b64decode


if r == "":
    R = "1:1" 
else:
    R=r

if not f : f = "temp.png"

INPUT_MIX = I
IMAGE_MODEL = "gemini-2.5-flash-image"

script_dir =  os.path.dirname(ghdoc.Path)
output_path = os.path.join(script_dir,f)

INPUT = []
for i in INPUT_MIX:
    try:
        img = Image.open(BytesIO(b64decode(i)))
        INPUT.append(img)
    except:
        INPUT.append(i)


if run == True :
    client = genai.Client(api_key=K)

    response = client.models.generate_content(
        model=IMAGE_MODEL,
        contents=INPUT,
        config=types.GenerateContentConfig(
            response_modalities=["Image"],
            image_config=types.ImageConfig(
                aspect_ratio=R,
            )
        )
    )

    if response.candidates:
        for i, candidate in enumerate(response.candidates):
            for part in candidate.content.parts:
                
                if part.inline_data is not None:
                    
                    image_data = part.inline_data.data
                    image = Image.open(BytesIO(image_data))

                    filename = output_path
                    image.save(filename)
                    print(f"Successfully generated and saved image: {filename}")

                    P = filename

    else:
        print("Image generation failed or returned no candidates.")

    client.close()
# ---------- end py3_3 ----------
merge = Merge(Data1=panel, Data2=py3_2.D, Data3=style)
merge_2 = Merge(Data1=panel_2, Data2=py3.D)
image_resource = ImageResource(py3_3.P)
py3_4 = Python3Script(K=paste_your_api_key, I=merge, r="1:1", f="view2.png", run=Toggle(True))  # -> out, P; inputs K: String, I: list of String, r: String, run: Boolean; disabled
# ---------- py3_4: Python ----------
"""Grasshopper Script"""
# requirements: pillow, google-genai

import os
import Rhino
import System
import base64
from google import genai
from google.genai import types
from PIL import Image
from io import BytesIO
from base64 import b64encode, b64decode

if r == "":
    R = "1:1" 
else:
    R=r

if not f : f = "temp.png"

INPUT_MIX = I
IMAGE_MODEL = "gemini-2.5-flash-image"

script_dir =  os.path.dirname(ghdoc.Path)
output_path = os.path.join(script_dir,f)

INPUT = []
for i in INPUT_MIX:
    try:
        img = Image.open(BytesIO(b64decode(i)))
        INPUT.append(img)
    except:
        INPUT.append(i)


if run == True :
    client = genai.Client(api_key=K)

    response = client.models.generate_content(
        model=IMAGE_MODEL,
        contents=INPUT,
        config=types.GenerateContentConfig(
            response_modalities=["Image"],
            image_config=types.ImageConfig(
                aspect_ratio=R,
            )
        )
    )

    if response.candidates:
        for i, candidate in enumerate(response.candidates):
            for part in candidate.content.parts:
                
                if part.inline_data is not None:
                    
                    image_data = part.inline_data.data
                    image = Image.open(BytesIO(image_data))

                    filename = output_path
                    image.save(filename)
                    print(f"Successfully generated and saved image: {filename}")

                    P = filename

    else:
        print("Image generation failed or returned no candidates.")



    client.close()
# ---------- end py3_4 ----------
py3_5 = Python3Script(K=paste_your_api_key, I=merge_2, r="1:1", f="view1.png", run=Toggle(True))  # -> out, P; inputs K: String, I: list of String, r: String, run: Boolean; disabled; same code as py3_3
panel_5 = Panel("Place the spaceship inside a gigantic hangar. It just finished construction")
py3_6 = Python3Script(P=py3_4.P)  # -> out, D; inputs P: String; disabled
# ---------- py3_6: Python ----------
"""Grasshopper Script"""
# requirements: pillow

import base64
from io import BytesIO
from PIL import Image

p = P

def image_to_base64(img: Image.Image, format: str = "PNG") -> str:

    buffer = BytesIO()
    img.save(buffer, format=format)
    buffer.seek(0)
    return base64.b64encode(buffer.read()).decode("utf-8")

img = Image.open(p)
D = image_to_base64(img)
# ---------- end py3_6 ----------
style_2 = Text(panel_3)
image_resource_2 = ImageResource(py3_5.P)
image_resource_3 = ImageResource(py3_4.P)
merge_3 = Merge(Data1=panel_5, Data2=py3_6.D, Data3=style_2)
py3_7 = Python3Script(K=paste_your_api_key, I=merge_3, r="1:1", f="view2-post.png", run=Toggle(True))  # -> out, P; inputs K: String, I: list of String, r: String, run: Boolean; disabled; same code as py3_3
image_resource_4 = ImageResource(py3_7.P)

# ----
# Send requests to
# google API
# Capture a named
# viewport
# Open a image file
send_request = Python3Script()  # -> out, P; inputs K: String, I: list of String, r: String, run: Boolean; same code as py3_3
get_viewport = Python3Script()  # -> out, D; inputs V: String; same code as py3
open_image = Python3Script()  # -> out, D; inputs P: String; same code as py3_6
